# Grasshopper definition DAY_5_DISCRETE VARIABLES.gh (Grasshopper 0.9.76)
# plug-ins: Anemone, Weaverbird

# ---- group: discrete star
number_slider = Slider(4, range=0..10)
box = CenterBox(Base=PlaneXY(0, 0, 0), X=number_slider, Y=number_slider, Z=number_slider)
mbox = MeshBox(Base=box, XCount="2", YCount="2", ZCount="2")
wbjoin = WeaverbirdsJoinMeshesAndWeld(Mesh=mbox, Weld=Toggle(True))
volume = Volume(Geometry=box)  # -> Volume, Centroid
demesh = DeconstructMesh(Mesh=wbjoin)  # -> Vertices, Faces, Colours, Normals
ln = Line(StartPoint=volume.Centroid, EndPoint=demesh.Vertices)

# ---- group: shuffle vector order
shift = ShiftList(List=ln, Shift=Slider(12, range=0..26), Wrap=True)
jitter = Jitter(List=shift, Jitter=Slider(0, range=0..1), Seed=2)  # -> Values, Indices
group = Group(Objects=jitter.Values)

# ---- group: start points
box_2 = CenterBox(Base=PlaneXY(0, 0, 0), X=Slider(50, range=0..100), Y=Slider(50, range=0..100), Z=Slider(50, range=0..100))
smesh = SimpleMesh(Brep=box_2)
popgeo = PopulateGeometry(Geometry=smesh, Count=Slider(800, range=0..1000), Seed=6)
pt = Point(graft(popgeo))

# ---- group: field
number_slider_2 = Slider(5, range=0..10)
popgeo_2 = PopulateGeometry(Geometry=smesh, Count=number_slider_2, Seed=Slider(49, range=0..100))
xy = XYPlane(Origin=popgeo_2)
lng = ListLength(List=xy)
random = Random(Range=Domain(-0.5, 0.5), Number=lng, Seed=2)
xz = XZPlane(Origin=Point(0, 0, 0))
random_2 = Random(Range=Domain(-180, 180), Number=number_slider_2, Seed=Slider(66, range=0..100))
rot3d = Rotate3D(Geometry=xy, Angle=degrees(random_2), Center=popgeo_2, Axis=xz)  # -> Geometry, Transform
fspin = SpinForce(Plane=rot3d.Geometry, Strength=random, Radius=Slider(20, range=0..20), Decay=Slider(3, range=0..10))
mergef = MergeFields(Fields=fspin)

# ----
number_slider_3 = Slider(40, range=0..1000)
loop_start = LoopStart(Repeat=number_slider_3, Trigger=Button(), Data=pt)  # -> port, Counter, Data
panel = Panel(loop_start.Counter)

# ---- group: MERGE VECTOR FIELDS
mergef_2 = MergeFields(Fields=flatten(mergef))
pt_2 = Point(simplify(loop_start.Data))
evf = EvaluateField(Field=mergef_2, Point=simplify(pt_2))  # -> Tensor, Strength

# ---- group: custom movement length
number_slider_4 = Slider(3, range=0..20)

# ---- group: DISCRETIZATION APPLIED TO ALL AGENTS
vec2pt = Vector2Pt(PointA=volume.Centroid, PointB=flatten(loop_start.Data), Unitize=False)  # -> Vector, Length
move = Move(Geometry=group, Motion=graft(vec2pt.Vector))  # -> simplify(Geometry), Transform
ungroup = Ungroup(Group=move.Geometry)  # -> simplify(Objects)
amp = Amplitude(Vector=ungroup, Amplitude=number_slider_4)

angle = Angle(VectorA=evf.Tensor, VectorB=amp)  # -> Angle, Reflex
sort = SortList(Keys=simplify(angle.Angle), ValuesA=amp)  # -> Keys, ValuesA
item = ListItem(List=sort.ValuesA, Index=0, Wrap=True)  # -> simplify(Item)

# ----
move_2 = Move(Geometry=loop_start.Data, Motion=item)  # -> Geometry, Transform
loop_end = LoopEnd(port=loop_start.port, Exit=False, Data=move_2.Geometry, pausedState=False, state="Constant & Record", TimeOutVal=0)

# ---- group: GENERATING TRAIL FROM RECORDED HISTORY
pshift = ShiftPaths(Data=loop_end, Offset=-1)
flip = FlipMatrix(Data=pshift)
pline = PolyLine(Vertices=flip, Closed=False)

# ----
equals = Equality(FirstNumber=loop_start.Counter, SecondNumber=number_slider_3)  # -> Equality, Inequality

# ---- group: end viz
gate = StreamGate(Stream=pline, Gate=equals.Equality)  # -> Target0, Target1
preview = CustomPreview(Geometry=pline, Shader=ColourSwatch(SwatchColor=RGB(255, 255, 255)))
preview_2 = CustomPreview(Geometry=gate.Target1, Shader=ColourSwatch(SwatchColor=RGB(255, 255, 255)))
